# Dynamo custom node GetElement.dyf "Element from ID" (Dynamo 2.3.0.5885)
# category: Antler.Revit.Collect.Query
# Get elements from element ID

Id = Input(Id: var[]..[])
element_from_id = Python(IN[0]=Id)
# ---------- element_from_id.python (45 lines) ----------
import clr

clr.AddReference('ProtoGeometry')
from Autodesk.DesignScript.Geometry import *

# Import RevitAPI
clr.AddReference("RevitAPI")
import Autodesk
from Autodesk.Revit.DB import *

# Import DocumentManager and TransactionManager
clr.AddReference("RevitServices")
import RevitServices
from RevitServices.Persistence import DocumentManager
from RevitServices.Transactions import TransactionManager

# Import ToDSType(bool) extension method
clr.AddReference("RevitNodes")
import Revit
clr.ImportExtensions(Revit.Elements)
clr.ImportExtensions(Revit.GeometryConversion)

# Import Revit UI
clr.AddReference('RevitAPIUI')
from Autodesk.Revit.UI import *
#from Autodesk.Revit.UI.Selection import *

import sys

#The inputs to this node will be stored as a list in the IN variables.
doc = DocumentManager.Instance.CurrentDBDocument

ids = IN[0]

def function(element_id):
	if isinstance(element_id, (list, tuple)):
		return [function(e) for e in element_id]
	else:
		# Code follows here:
		#element = UnwrapElement(element)
		if element_id:
			element = doc.GetElement(element_id)
			return element

OUT = function(ids)
# ----------------------------------------
Element = Output(element_from_id)
