# Dynamo custom node GetPolyCurves.dyf (Dynamo 2.6.1.8786)
# category: Antler.Geometry

curves = Input(curves: var[]..[])
python_script = Python(IN[0]=curves)
# ---------- python_script.python (64 lines) ----------
# Enable Python support and load DesignScript library
import clr

# Import RevitAPI
clr.AddReference("RevitAPI")
from Autodesk.Revit import DB

# Import ToDSType(bool) extension method
clr.AddReference("RevitNodes")
import Revit
clr.ImportExtensions(Revit.Elements)
clr.ImportExtensions(Revit.GeometryConversion)


# Import DocumentManager and TransactionManager
clr.AddReference ("RevitServices")
import RevitServices
from RevitServices.Persistence import DocumentManager
#from RevitServices.Transactions import TransactionManager

#doc = DocumentManager.Instance.CurrentDBDocument

#The inputs to this node will be stored as a list in the IN variable.
crvs = IN[0]

		
def find_next(pt, crv_candidates):
	for crv in crv_candidates:
		if pt.IsAlmostEqualTo(crv.StartPoint):
			return crv
		elif pt.IsAlmostEqualTo(crv.EndPoint):
			return crv.Reverse()
			

def extract_crv_loop(crvs):
	loops = []
	
	loop = []
	
	while crvs:
		
		loop = loop or [crvs.pop(0)]
		
		next = find_next(loop[-1].EndPoint, crvs)
		
		if next:
			loop.append(next)
			if next in crvs:
				crvs.remove(next)
		else:
			loops.append(loop)
			loop = []
	
	if loop:
		loops.append(loop)
	
	return loops


def process(item):
	return extract_crv_loop(item)
		

OUT = process(crvs)
# ----------------------------------------
byJoinedCurves = PolyCurve.ByJoinedCurves(curves=python_script)
poly_curves = Output(byJoinedCurves)
watch = Watch(python_script)
