# Dynamo custom node GetWallTrimmedCurve.dyf (Dynamo 2.6.1.8786)
# category: Antler.Revit.Elements.Walls
#  Obtains the curve of the wall trimmed or extended according to the end conditions of the wall.

wall = Input(wall: var[]..[])
python_script = Python(IN[0]=wall)
# ---------- python_script.python (30 lines) ----------
# Enable Python support and load DesignScript library
import clr

# Import RevitAPI
clr.AddReference("RevitAPI")
clr.AddReference("RevitAPIIFC")
from Autodesk.Revit import DB

# Import ToDSType(bool) extension method
clr.AddReference("RevitNodes")
import Revit
clr.ImportExtensions(Revit.Elements)
clr.ImportExtensions(Revit.GeometryConversion)

#The inputs to this node will be stored as a list in the IN variable.
elements = IN[0]

def function(element):
		# Code follows here:
		element = UnwrapElement(element)
		
		return DB.IFC.ExporterIFCUtils.GetWallTrimmedCurve(element).Convert()

def process(item):
	if isinstance(item, (list, tuple)):
		return [process(a) for a in item]
	elif item:
		return function(item)

OUT = process(elements)
# ----------------------------------------
curves = Output(python_script)
