# Dynamo custom node GroupByGeometryType.dyf (Dynamo 2.6.1.8786)
# category: Antler.Geometry

geometry = Input(geometry: var[]..[])
python_script = Python(IN[0]=geometry)
# ---------- python_script.python (36 lines) ----------
# Enable Python support and load DesignScript library
import clr

# Import RevitAPI
clr.AddReference("RevitAPI")
from Autodesk.Revit import DB

from collections import defaultdict

#The inputs to this node will be stored as a list in the IN variable.
elements = IN[0]

switch = {
	
	}

def function(element):
		# Code follows here:
		element = UnwrapElement(element)
		
		return {str(type(element)): element}

def process(item):
	if isinstance(item, (list, tuple)):
		return [process(a) for a in item]
	else:
		return function(item)
		
"""
a = defaultdict(dict)

for item in IN[0]:
	a[type(UnwrapElement(item))] = item
"""

OUT = process(elements)
# ----------------------------------------
code_block = CodeBlock { "<type 'Line'>"; }
valueAtKey = DesignScript.Builtin.Dictionary.ValueAtKey(dictionary=python_script, key=code_block)
lines = Output(valueAtKey)
watch = Watch(python_script)
code_block_2 = CodeBlock { "<type 'Solid'>"; }
valueAtKey_2 = DesignScript.Builtin.Dictionary.ValueAtKey(dictionary=python_script, key=code_block_2)
solids = Output(valueAtKey_2)
code_block_3 = CodeBlock { "<type 'Surface'>"; }
valueAtKey_3 = DesignScript.Builtin.Dictionary.ValueAtKey(dictionary=python_script, key=code_block_3)
surfaces = Output(valueAtKey_3)
code_block_4 = CodeBlock { "<type 'Arc'>"; }
valueAtKey_4 = DesignScript.Builtin.Dictionary.ValueAtKey(dictionary=python_script, key=code_block_4)
arcs = Output(valueAtKey_3)
