# Dynamo custom node ReferenceIntersector.dyf (Dynamo 2.6.1.8786)
# category: Antler.Revit.Collect.Query
# Finds Elements in 3D by input Points and direction. By default the function searches for elements below the points. You must also supply a 3D View and minimum one category to search for. Works similar to RayBounce.

category = Input(category: Revit.Elements.Category)
elementCategoryFilter = Python(IN[0]=category)
# ---------- elementCategoryFilter.python (29 lines) ----------
# Load the Python Standard and DesignScript Libraries
import sys
import clr
clr.AddReference('ProtoGeometry')
from Autodesk.DesignScript.Geometry import *

# Import RevitAPI
clr.AddReference("RevitAPI")
from Autodesk.Revit import DB

import System.Enum

# The inputs to this node will be stored as a list in the IN variables.
category = UnwrapElement(IN[0])

def builtin_category_from_category(category):
    """
    Returns corresponding Builtin Category from Category.
    """
    for builtin_category in System.Enum.GetValues(DB.BuiltInCategory):
        if DB.ElementId(builtin_category) == category.Id:
            return builtin_category


# Place your code below this line
element_filter = DB.ElementCategoryFilter(builtin_category_from_category(category))

# Assign your output to the OUT variable.
OUT = element_filter
# ----------------------------------------
view_3d = Input(view_3d: Revit.Elements.Views.View)
get_intersector = Python(IN[0]=elementCategoryFilter, IN[1]=view_3d)
# ---------- get_intersector.python (31 lines) ----------
# Load the Python Standard and DesignScript Libraries
import sys
import clr
clr.AddReference('ProtoGeometry')
from Autodesk.DesignScript.Geometry import *

# Import RevitAPI
clr.AddReference("RevitAPI")
from Autodesk.Revit import DB

from System.Collections.Generic import List



# The inputs to this node will be stored as a list in the IN variables.

element_filter = IN[0]
view_3d = IN[1]


# Place your code below this line
def get_intersector(element_filter, view_3d):
	intersector = DB.ReferenceIntersector(element_filter, DB.FindReferenceTarget.Element, view_3d)
	
	return intersector

		
intersector = get_intersector(element_filter, UnwrapElement(view_3d))

# Assign your output to the OUT variable.
OUT = intersector
# ----------------------------------------
points = Input(points: var[]..[])
direction = Input(direction: Autodesk.DesignScript.Geometry.Vector = Autodesk.DesignScript.Geometry.Vector.ByCoordinates(0, 0, -1))
intersect = Python(IN[0]=get_intersector, IN[1]=points, IN[2]=direction)
# ---------- intersect.python (69 lines) ----------
# Load the Python Standard and DesignScript Libraries
import sys
import clr
clr.AddReference('ProtoGeometry')
from Autodesk.DesignScript.Geometry import *

# Import RevitAPI
clr.AddReference("RevitAPI")
from Autodesk.Revit import DB

from System.Collections.Generic import List

# Import ToDSType(bool) extension method
clr.AddReference("RevitNodes")
import Revit
clr.ImportExtensions(Revit.Elements)
clr.ImportExtensions(Revit.GeometryConversion)

clr.AddReference ("RevitServices")
import RevitServices
from RevitServices.Persistence import DocumentManager

doc = DocumentManager.Instance.CurrentDBDocument

# The inputs to this node will be stored as a list in the IN variables.
intersector = IN[0]
origin_pts = IN[1]
direction = IN[2] or DB.XYZ(0,0,-1)


# Place your code below this line
def find_associated_floor(
	intersector, origin_xyz, direction=DB.XYZ(0,0,-1)):
	#location_offset = family_instance.FacingOrientation.Negate().Multiply(ray_offset)

	#origin = family_instance.Location.Point.Add(location_offset)


	reference_with_context = intersector.FindNearest(origin_xyz, direction)

	if reference_with_context:
		reference = reference_with_context.GetReference()
		
		element = doc.GetElement(reference.ElementId)

		return element, reference.GlobalPoint.ToPoint()
	else:
		return None, None

elements = []
pts = []

for origin_pt in origin_pts:
	if origin_pt:
		origin_xyz = origin_pt.ToRevitType()
		
		element, pt = find_associated_floor(
			intersector, 
			origin_xyz
			)
	else:
		element = None
		pt = None

	elements.append(element)
	pts.append(pt)

# Assign your output to the OUT variable.
OUT = elements, pts
# ----------------------------------------
code_block = CodeBlock { 0; }
getItemAtIndex = List.GetItemAtIndex(list=intersect, index=code_block)
element = Output(getItemAtIndex)
code_block_2 = CodeBlock { 1; }
getItemAtIndex_2 = List.GetItemAtIndex(list=intersect, index=code_block_2)
hit_point = Output(getItemAtIndex_2)
