# Dynamo custom node UnjoinedWallGeometry.dyf (Dynamo 2.6.1.8786)
# category: Antler.Revit.Elements.Walls
# Returns wall geometry as if it's not allowed to join.

walls = Input(walls: var[]..[])
python_script = Python(IN[0]=walls)
# ---------- python_script.python (99 lines) ----------
# Enable Python support and load DesignScript library
import clr

# Import RevitAPI
clr.AddReference("RevitAPI")
from Autodesk.Revit import DB

# Import ToDSType(bool) extension method
clr.AddReference("RevitNodes")
import Revit
clr.ImportExtensions(Revit.Elements)
clr.ImportExtensions(Revit.GeometryConversion)


# Import DocumentManager and TransactionManager
clr.AddReference ("RevitServices")
import RevitServices
from RevitServices.Persistence import DocumentManager
from RevitServices.Transactions import TransactionManager

doc = DocumentManager.Instance.CurrentDBDocument


#The inputs to this node will be stored as a list in the IN variable.
elements = IN[0]

def valid_solid_filter(geometry_object):
	if isinstance(geometry_object, DB.Solid) and\
		geometry_object.Faces.Size > 0 and\
		geometry_object.Edges.Size > 0 and\
		geometry_object.Volume > 0:
		return True
	else:
		return False
		

		
def get_solids(element):
	solids = []
	
	options = DB.Options()
	
	geometry_element = element.get_Geometry(options)
	
	for geometry_object in geometry_element:

		if valid_solid_filter(geometry_object):

			solids.append(geometry_object.ToProtoType())
			
	return solids




def function(element):
	element = UnwrapElement(element)
	
	st = DB.SubTransaction(doc)
	
	try:
		st.Start()
		
		DB.WallUtils.DisallowWallJoinAtEnd(element, 0)
		DB.WallUtils.DisallowWallJoinAtEnd(element, 1)
		
		solids = get_solids(element)
		
	except Exception as e:
		raise e
	else:
		return solids
	finally:
		pass
		st.RollBack()
		st.Dispose()
		
			

def process(item):
	if isinstance(item, (list, tuple)):
		return [process(a) for a in item]
	elif item:
		return function(item)
		

t = DB.Transaction(doc, "Get unjoined geometry")

try:
	t.Start()
	
	geometry = process(elements)
except Exception as e:
	raise e
else:
	OUT = geometry
finally:
	t.RollBack()
	t.Dispose()
# ----------------------------------------
geometry = Output(python_script)
