# Dynamo custom node VectorsAlmostParallel.dyf (Dynamo 2.6.1.8786)
# category: Antler.Geometry.Vectors
# Returns true if vectors are almost parallel.

code_block = CodeBlock()
# ---------- code_block.designscript (9 lines) ----------
def vectors_are_almost_equal (
	a, b, tolerance)

	{
	angle = Vector.AngleWithVector(
		a, b);

	return Math.Sin(angle) < Math.Sin(tolerance);
	};
# ----------------------------------------
vector_a = Input(vector_a: var[]..[])
vector_b = Input(vector_b: var[]..[])
angle_tolerance = Input(angle_tolerance: var[]..[])
code_block_2 = CodeBlock(a=vector_a, b=vector_b, angle_tolerance=angle_tolerance)
# ---------- code_block_2.designscript (4 lines) ----------
vectors_are_almost_equal(
	a,
	b,
	angle_tolerance);
# ----------------------------------------
boolean = Output(code_block_2)
code_block_3 = CodeBlock()
# ---------- code_block_3.designscript (7 lines) ----------
def lines_are_almost_parallel (
	a, b, tolerance=0.1 )
	{

	return vectors_are_almost_equal(
		a, b, tolerance);
	};
# ----------------------------------------
