# Dynamo custom node AssureNumber.dyf (Dynamo 2.6.1.8786)
# category: Antler.Utilities.Actions
# Makes sure that the input is a number. Strings are converted to floats or integers, and numbers are returned unharmed.

number_or_string = Input(number_or_string: var[]..[])
python_script = Python(IN[0]=number_or_string)
# ---------- python_script.python (20 lines) ----------
def assure_number(a):
	if isinstance(a, (float, int)):
		return a
	elif isinstance(a, basestring):
		try:
			n = int(a)
		except:
			n = float(a)
		finally:
			return n
			
def process(item):
	if isinstance(item, basestring):
		return assure_number(item)
	elif isinstance(item, (list, tuple)):
		return [process(a) for a in item]
	else:	
		return assure_number(item)

OUT = process(IN[0])
# ----------------------------------------
number = Output(python_script)
