# Dynamo custom node Document.All open Documents.dyf "All open Documents" (Dynamo 2.6.1.8786)
# category: Antler.Revit.Document.Query
# Gets all open documents, including Links.

python_script = Python()
# ---------- python_script.python (58 lines) ----------
# Enable Python support and load DesignScript library
import clr

clr.AddReference('ProtoGeometry')
from Autodesk.DesignScript.Geometry import *

# Import RevitAPI
clr.AddReference("RevitAPI")
from Autodesk.Revit.DB import *
import Autodesk.Revit.ApplicationServices

clr.AddReference('RevitAPIUI')
import Autodesk.Revit.UI

# Import DocumentManager and TransactionManager
clr.AddReference("RevitServices")
import RevitServices
from RevitServices.Persistence import DocumentManager
from RevitServices.Transactions import TransactionManager

# Import ToDSType(bool) extension method
clr.AddReference("RevitNodes")
import Revit
clr.ImportExtensions(Revit.Elements)
clr.ImportExtensions(Revit.GeometryConversion)



# Code
#doc = DocumentManager.Instance.CurrentDBDocument
uiapp = DocumentManager.Instance.CurrentUIApplication
app = uiapp.Application

#app = Autodesk.Revit.UI.UIApplicatio

docs = app.Documents #.ForwardIterator()

titles = [doc.Title for doc in docs]
paths = [doc.PathName for doc in docs]
is_linked = [doc.IsLinked for doc in docs]
is_family_doc = [doc.IsFamilyDocument for doc in docs]

#docs = [doc.ToDSType(True) for doc in docs]

"""
docs = []

#iter = Application.Documents#.ForwardIterator()
i = 0

while iter and i < 5:
	iter.MoveNext()
	docs.append(iter.Current)
	#iter.MoveNext()
	i += 1
"""
# Assign your output to the OUT variable.
OUT = docs, titles, paths, is_linked, is_family_doc
# ----------------------------------------
code_block = CodeBlock(t=python_script) { t[0]; t[1]; t[2]; t[3]; t[4]; }
doc = Output(code_block.out0)
title = Output(code_block.out1)
file_path = Output(code_block.out2)
is_linked = Output(code_block.out3)
is_family_doc = Output(code_block.out4)
watch = Watch(python_script)
