# Dynamo custom node DynamoCustomPackageFolders.dyf (Dynamo 2.3.0.5885)
# category: Antler.Utilities.Query
# Gets all custom package folders stored in DynamoSettings.xml.

python_script = Python()
# ---------- python_script.python (27 lines) ----------
import os

from System.Reflection import Assembly

import xml.etree.ElementTree as etree



dynamo_version = Assembly.Load('DynamoCore').GetName().Version

dynamo_settings_path = os.path.join(
	os.getenv('appdata'),
	"Dynamo\\Dynamo Revit",
	"{}.{}".format(dynamo_version.Major, dynamo_version.Minor),
	"DynamoSettings.xml"
	)
	

with open(dynamo_settings_path, 'rb') as f:
	tree = etree.parse(f)
	root = tree.getroot()

	custom_package_folders = [e.text for e in root.findall(
		'CustomPackageFolders/string')]


OUT = custom_package_folders
# ----------------------------------------
folders = Output(python_script)
