# Dynamo custom node ExtractElementSurfacesWithMaterials.dyf (Dynamo 2.3.0.5885)
# category: Antler.Revit.Elements.Element.Query
# Extracts surfaces from input element with a parallel list of materials for each surface.

element = Input(element: var[]..[])
optional_view = Input(optional_view: Revit.Elements.Views.View = null)
get_geometry = Python(IN[0]=element, IN[1]=optional_view)
# ---------- get_geometry.python (141 lines) ----------
import clr

clr.AddReference('ProtoGeometry')
from Autodesk.DesignScript.Geometry import *

# Import RevitAPI
clr.AddReference("RevitAPI")
import Autodesk
from Autodesk.Revit.DB import *

# Import DocumentManager and TransactionManager
clr.AddReference("RevitServices")
import RevitServices
from RevitServices.Persistence import DocumentManager
from RevitServices.Transactions import TransactionManager

# Import ToDSType(bool) extension method
clr.AddReference("RevitNodes")
import Revit
clr.ImportExtensions(Revit.Elements)
clr.ImportExtensions(Revit.GeometryConversion)

# Import RevitAPI
clr.AddReference("RevitAPI")
import Autodesk
from Autodesk.Revit import DB

import traceback

# Import Revit UI
#clr.AddReference('RevitAPIUI')
#from Autodesk.Revit.UI import *
#from Autodesk.Revit.UI.Selection import *

from Autodesk.DesignScript.Geometry import *

#The inputs to this node will be stored as a list in the IN variables.
input = IN[0]
view = UnwrapElement(IN[1])


def get_instance_faces(instance, **attrs):
	options = DB.Options()

	for attr, value in attrs.items():
		setattr(options, attr, value)

	faces = []
	
	geometry_element = instance.get_Geometry(options)
	
	for geometry_object in geometry_element:
		geometry_instance = clr.Convert(geometry_object, DB.GeometryInstance)
		
		if geometry_instance:
			instance_geometry = geometry_instance.GetInstanceGeometry()
			
			faces.append(extract_faces(instance_geometry))
	
	return faces
	
def get_type_faces(element_type, **attrs):
	options = DB.Options()

	for attr, value in attrs.items():
		setattr(options, attr, value)

	faces = []
	
	geometry_element = element_type.get_Geometry(options)
	
	faces = extract_faces(geometry_element)
	
	return faces
	

def valid_solid_filter(geometry_object):
    if isinstance(geometry_object, DB.Solid) and\
    	geometry_object.Faces.Size > 0 and\
    	geometry_object.Edges.Size > 0 and\
    	geometry_object.Volume > 0:
        return True


def extract_faces(geometry_element):
	faces = []
	
	for geometry in geometry_element:
		geometry_element_faces = []
		
		if valid_solid_filter(geometry):
			geometry_element_faces.append(geometry.Faces)
		
		if geometry_element_faces:
			faces.append(geometry_element_faces)
			
	return faces
	
	
            




def get_element_faces(element, **attrs):
	options = DB.Options()

	for attr, value in attrs.items():
		setattr(options, attr, value)

	faces = []
	
	geometry_element = element.get_Geometry(options)
	
	if isinstance(element, DB.ElementType):
		faces = extract_faces(geometry_element)
	else:
		for geometry_object in geometry_element:
			geometry_instance = clr.Convert(geometry_object, DB.GeometryInstance)
			
			if geometry_instance:
				instance_geometry = geometry_instance.GetInstanceGeometry()
				
				faces.append(extract_faces(instance_geometry))
	
	return faces		

attrs = {}

if view:
	attrs['View'] = view

if isinstance(input, list):
    faces = [get_element_faces(UnwrapElement(a), **attrs) for a in input]
elif input is None:
	faces = []
else:
    faces = get_element_faces(UnwrapElement(input), **attrs)


OUT = faces
# ----------------------------------------
watch = Watch(get_geometry)
convert = Python(IN[0]=get_geometry)
# ---------- convert.python (26 lines) ----------
# Enable Python support and load DesignScript library
import clr

# Import RevitAPI
clr.AddReference("RevitAPI")
from Autodesk.Revit import DB

# Import ToDSType(bool) extension method
clr.AddReference("RevitNodes")
import Revit
clr.ImportExtensions(Revit.Elements)
clr.ImportExtensions(Revit.GeometryConversion)

#The inputs to this node will be stored as a list in the IN variable.
elements = IN[0]

def function(element):
	if isinstance(element, (list, tuple)):
		return [function(e) for e in element]
	else:
		# Code follows here:
		#element = UnwrapElement(element)
		
		return element.Convert()

OUT = function(elements)
# ----------------------------------------
surfaces = Output(convert)
materialElementId = Python(IN[0]=get_geometry)
# ---------- materialElementId.python (20 lines) ----------
# Enable Python support and load DesignScript library
import clr

# Import RevitAPI
clr.AddReference("RevitAPI")
from Autodesk.Revit import DB

#The inputs to this node will be stored as a list in the IN variable.
elements = IN[0]

def function(element):
	if isinstance(element, (list, tuple)):
		return [function(e) for e in element]
	else:
		# Code follows here:
		#element = UnwrapElement(element)
		if element:
			return element.MaterialElementId

OUT = function(elements)
# ----------------------------------------
element_from_id = Custom[Element from ID](Id=materialElementId)  # Get elements from element ID
materials = Output(element_from_id)
watch_2 = Watch(get_geometry)
