# Dynamo custom node ExtractNumbers.dyf (Dynamo 2.6.1.8786)
# category: Antler.Strings
# Extracts numbers from string.

string = Input(string_: var[]..[])
python_script = Python(IN[0]=string)
# ---------- python_script.python (19 lines) ----------
import re

string = IN[0]

number_pattern = "\d+\.*\d*"

matches = re.findall(number_pattern, string)

numbers = []

for match in matches:
	try:
		number = int(match)
	except:
		number = float(match)
	
	numbers.append(number)

OUT = numbers
# ----------------------------------------
numbers = Output(python_script)
