# Dynamo custom node ExtractSurfaces.dyf "ExtractElementSurfaces" (Dynamo 2.3.0.5885)
# category: Antler.Revit.Elements.Element.Query
# Extracts transparent surfaces from input element.

element = Input(element: var[]..[])
view = Input(view: var[]..[])
symbol_geomtry = Python(IN[0]=element, IN[1]=view)
# ---------- symbol_geomtry.python (92 lines) ----------
import clr

clr.AddReference('ProtoGeometry')
from Autodesk.DesignScript.Geometry import *

# Import RevitAPI
clr.AddReference("RevitAPI")
import Autodesk
from Autodesk.Revit.DB import *

# Import DocumentManager and TransactionManager
clr.AddReference("RevitServices")
import RevitServices
from RevitServices.Persistence import DocumentManager
from RevitServices.Transactions import TransactionManager

# Import ToDSType(bool) extension method
clr.AddReference("RevitNodes")
import Revit
clr.ImportExtensions(Revit.Elements)
clr.ImportExtensions(Revit.GeometryConversion)

# Import RevitAPI
clr.AddReference("RevitAPI")
import Autodesk
from Autodesk.Revit import DB

# Import Revit UI
#clr.AddReference('RevitAPIUI')
#from Autodesk.Revit.UI import *
#from Autodesk.Revit.UI.Selection import *

from Autodesk.DesignScript.Geometry import *

#The inputs to this node will be stored as a list in the IN variables.
input = IN[0]
view = UnwrapElement(IN[1])

def valid_solid_filter(geometry_object):
    if isinstance(geometry_object, DB.Solid):
        if geometry_object.Faces.Size > 0:
            return True

def get_family_instance_faces(family_instance, **attrs):
	options = DB.Options()

	for attr, value in attrs.items():
		setattr(options, attr, value)

	faces = []

	for geometry_element in family_instance.get_Geometry(options):

		geometry_element_faces = []

		#for geometry in geometry_element.GetInstanceGeometry():
		if isinstance(geometry_element, Autodesk.Revit.DB.Solid):
			
			if valid_solid_filter(geometry_element):

				geometry_element_faces.append(geometry_element.Faces)
		
		if geometry_element_faces:

			faces.append(geometry_element_faces)

	return faces

"""

def get_face_material_id(face):
	return face.MaterialElementId
"""	

output = None

attrs = {}

if view:
	attrs['View'] = view

if isinstance(input, list):
    faces = [get_family_instance_faces(UnwrapElement(a), **attrs) for a in input]
elif input is None:
	faces = []
else:
    faces = get_family_instance_faces(UnwrapElement(input), **attrs)

material_ids = []

#Assign your output to the OUT variable.
OUT = faces
# ----------------------------------------
convert = Python(IN[0]=symbol_geomtry)
# ---------- convert.python (26 lines) ----------
# Enable Python support and load DesignScript library
import clr

# Import RevitAPI
clr.AddReference("RevitAPI")
from Autodesk.Revit import DB

# Import ToDSType(bool) extension method
clr.AddReference("RevitNodes")
import Revit
clr.ImportExtensions(Revit.Elements)
clr.ImportExtensions(Revit.GeometryConversion)

#The inputs to this node will be stored as a list in the IN variable.
elements = IN[0]

def function(element):
	if isinstance(element, (list, tuple)):
		return [function(e) for e in element]
	else:
		# Code follows here:
		#element = UnwrapElement(element)
		
		return element.Convert()

OUT = function(elements)
# ----------------------------------------
materialElementId = Python(IN[0]=symbol_geomtry)
# ---------- materialElementId.python (20 lines) ----------
# Enable Python support and load DesignScript library
import clr

# Import RevitAPI
clr.AddReference("RevitAPI")
from Autodesk.Revit import DB

#The inputs to this node will be stored as a list in the IN variable.
elements = IN[0]

def function(element):
	if isinstance(element, (list, tuple)):
		return [function(e) for e in element]
	else:
		# Code follows here:
		#element = UnwrapElement(element)
		
		return element.MaterialElementId

OUT = function(elements)
# ----------------------------------------
element_from_id = Custom[Element from ID](Id=materialElementId)  # Get elements from element ID
transparency = Material.Transparency(material=element_from_id)
min_transparency = Input(min_transparency: var[]..[])
gt = transparency > min_transparency
filterByBoolMask = List.FilterByBoolMask(list=convert, mask=gt)
watch = Watch(filterByBoolMask.in)
code_block = CodeBlock { 3; }
identity = Object.Identity(obj=filterByBoolMask.in)
code_block_2 = CodeBlock { 0.5; }
normalAtParameter = Surface.NormalAtParameter(surface=identity, u=code_block_2, v=code_block_2)
normal = Input(normal: Autodesk.DesignScript.Geometry.Vector)
code_block_3 = CodeBlock(vector=normal) { vector; }
isAlmostEqualTo = Vector.IsAlmostEqualTo(vector=normalAtParameter, other=code_block_3)
filterByBoolMask_2 = List.FilterByBoolMask(list=identity, mask=isAlmostEqualTo)
flatten = List.Flatten()  # unwired: list
map = List.Map(list=filterByBoolMask_2.in, f_x=flatten)
code_block_4 = CodeBlock(surface=map) { surface; }
code_block_5 = CodeBlock { 0.5; }
pointAtParameter = Surface.PointAtParameter(surface=code_block_4, u=code_block_5, v=code_block_5)
byCoordinates = Point.ByCoordinates()
code_block_6 = CodeBlock(vector=normal) { vector; }
byOriginNormal = Plane.ByOriginNormal(origin=byCoordinates, normal=code_block_6)
code_block_7 = CodeBlock(plane=byOriginNormal, pt=pointAtParameter)
# ---------- code_block_7.designscript (17 lines) ----------
// Pull point to plane

plane;
pt;

cs = CoordinateSystem.ByPlane(plane);

pt_transformed = Geometry.Transform(
	pt, CoordinateSystem.Inverse(cs));

pt_on_plane = Point.ByCoordinates(
	pt_transformed.X,
	pt_transformed.Y,
	0
);

pt_pulled = Geometry.Transform(pt_on_plane, cs);
# ----------------------------------------
byTwoPoints = Vector.ByTwoPoints(start=pointAtParameter, end=code_block_7.pt_pulled)
translate = Geometry.Translate(geometry=code_block_4, direction=byTwoPoints)
flatten_2 = List.Flatten()  # unwired: list
map_2 = List.Map(list=translate, f_x=flatten_2)
intersection = Custom[Intersection](srfs=map_2@L2)  # Gets intersection of multiple coplanar surfaces.
map_3 = List.Map(list=intersection, f_x=flatten_2)
surfaces = Output(map_3)
boolean = BoolSelector(false)
clean = List.Clean(list=intersection@L2, preserveIndices=boolean)
watch_2 = Watch(gt)
watch_3 = Watch(map_3)
watch_4 = Watch(symbol_geomtry)
perimeterCurves = Surface.PerimeterCurves(surface=code_block_4)
pullOntoPlane = Curve.PullOntoPlane(curve=perimeterCurves, plane=byOriginNormal)
byPatch = Surface.ByPatch(closedCurve=pullOntoPlane)
code_block_8 = CodeBlock { 3; }
flatten_3 = List.Flatten(amt=code_block_8)  # unwired: list
map_4 = List.Map(list=byPatch, f_x=flatten_3)
watch_5 = Watch(map)
raw = Output(map_2)
watch_6 = Watch(map_2)
code_block_9 = CodeBlock(vector=code_block_6)  # frozen
# ---------- code_block_9.designscript (4 lines) ----------
[
vector,
Vector.Reverse(vector)
];
# ----------------------------------------
project = Point.Project(point=pointAtParameter, baseGeometry=byOriginNormal, projectionDirection=code_block_9, lacing=CrossProduct)  # frozen
watch_7 = Watch(project)
watch_8 = Watch(map)
material_filter = Input(material_filter: function)
filter = List.Filter(list=element_from_id)  # unwired: condition
