# Dynamo custom node FamilyInstance.Flipped.dyf "Flipped" (Dynamo 2.6.1.8786)
# category: Antler.Revit.Elements.FamilyInstance.Query
# Returns True if familyinstance is flipped from direction in family editor

family_instance = Input(family_instance: var[]..[])

# group: Bestemme slagretning
handFlipped = Python(IN[0]=family_instance)  # "FamilyInstance.HandFlipped"
# ---------- handFlipped.python (17 lines) ----------
doors = IN[0]

def function(element):
		element = UnwrapElement(element)
		
		return element.HandFlipped

def process(item):
	if isinstance(item, (list, tuple)):
		return [process(a) for a in item]
	else:
		try:
			return function(item)
		except:
			return

OUT = process(doors)
# ----------------------------------------
facingFlipped = Python(IN[0]=family_instance)  # "FamilyInstance.FacingFlipped"
# ---------- facingFlipped.python (17 lines) ----------
doors = IN[0]

def function(element):
		element = UnwrapElement(element)
		
		return element.FacingFlipped

def process(item):
	if isinstance(item, (list, tuple)):
		return [process(a) for a in item]
	else:
		try:
			return function(item)
		except:
			return

OUT = process(doors)
# ----------------------------------------

hand_flipped = Output(handFlipped)
facing_flipped = Output(facingFlipped)
