# Dynamo custom node FamilyInstance.GetTransform.dyf "GetTransform" (Dynamo 2.6.1.8786)
# category: Antler.Revit.Elements.FamilyInstance.Query
# Gets Transform of FamilyInstance as a Coordinate System.

family_instance = Input(family_instance: var[]..[])
python_script = Python(IN[0]=family_instance)
# ---------- python_script.python (50 lines) ----------
# Enable Python support and load DesignScript library
import clr

# Import RevitAPI
clr.AddReference("RevitAPI")
from Autodesk.Revit import DB

# For working with DesignScript abstract geometry
clr.AddReference('ProtoGeometry')
from Autodesk.DesignScript.Geometry import *

#The inputs to this node will be stored as a list in the IN variable.
elements = IN[0]


def transform_to_coordinatesystem(transform):
	origin = transform.Origin
	origin_pt = Point.ByCoordinates(origin.X, origin.Y, origin.Z)
	
	basisX = transform.BasisX
	vectorX = Vector.ByCoordinates(basisX.X,basisX.Y,basisX.Z)
	
	basisY = transform.BasisY
	vectorY = Vector.ByCoordinates(basisY.X,basisY.Y,basisY.Z)	
	
	basisZ = transform.BasisZ
	vectorZ = Vector.ByCoordinates(basisZ.X,basisZ.Y,basisZ.Z)		
	
	coordinate_system = CoordinateSystem.ByOriginVectors(origin_pt, vectorX, vectorY, vectorZ)
	
	return coordinate_system
	
	
	
	return cs

def function(element):
	if isinstance(element, (list, tuple)):
		return [function(e) for e in element]
	else:
		# Code follows here:
		element = UnwrapElement(element)
		
		transform = element.GetTransform()
		
		cs = transform_to_coordinatesystem(transform)
		
		return cs

OUT = function(elements)
# ----------------------------------------
coordinate_system = Output(python_script)
