# Dynamo custom node FindSubfoldersByName.dyf (Dynamo 2.3.0.5885)
# category: Antler.Utilities
# Finds subfolders in input folder with given name. Node will search recursively and return all folders with given name.

folder = Input(folder: var[]..[])
subfolder_name = Input(subfolder_name: var[]..[])
python_script = Python(IN[0]=folder, IN[1]=subfolder_name)
# ---------- python_script.python (28 lines) ----------
# Load the Python Standard and DesignScript Libraries
#import sys
import os
#import clr

paths = IN[0]
subfolder = IN[1]



def find_subfolder(path, subfolder):
	for root, dirs, files in os.walk(path):
		if subfolder in dirs:
			yield os.path.join(root, subfolder)


found_paths = []


if isinstance(paths, (list, tuple)):
	[found_paths.extend(find_subfolder(path, subfolder)) for path in paths]
else:
	found_paths.append(find_subfolder(paths, subfolder))




OUT = found_paths
# ----------------------------------------
folders = Output(python_script)
