# Dynamo custom node GetAntlerLibFolders.dyf (Dynamo 2.3.0.5885)
# category: Antler.Utilities.Query
# Utility function to return the library folder for the Antler package. This folder contains python libraries necessary to run some its components.

code_block = CodeBlock { "8a8dd215-b7ce-4477-acc7-79e1b60a3ee1"; }
dynamoCustomPackageFolders = Custom[DynamoCustomPackageFolders]()  # Gets all custom package folders stored in DynamoSettings.xml.
code_block_2 = CodeBlock { "antler-revit"; }
findSubfoldersByName = Custom[FindSubfoldersByName](folder=dynamoCustomPackageFolders, subfolder_name=code_block_2)  # Finds subfolders in input folder with given name.
code_block_3 = CodeBlock(a=findSubfoldersByName) { a[0]; }
folder = Output(code_block_3)
