# Dynamo custom node GetElementsNearCurve.dyf (Dynamo 2.6.1.8786)
# category: Antler.Revit.Collect.Query
# Returns Elements which are intersecting or near a curve. Radius parameter defines how far from curve to find elements. Categories parameter is optional.

curve = Input(curve: var[]..[])
search_radius = Input(search_radius: var[]..[])
pipeCurve = Custom[PipeCurve](curve=curve, radius=search_radius)  # Returns a round pipe solid from input curve and radius.
categories = Input(categories: Revit.Elements.Category[]..[] = DSCore.List.Empty)
python_script = Python(IN[0]=pipeCurve.revit_solid, IN[1]=categories)
# ---------- python_script.python (75 lines) ----------
import clr

# Import RevitAPI
clr.AddReference("RevitAPI")
#import Autodesk
from Autodesk.Revit import DB

# Import List
from System.Collections.Generic import List

# Import ToDSType(bool) extension method
clr.AddReference("RevitNodes")
import Revit
#clr.ImportExtensions(Revit.Elements)
clr.ImportExtensions(Revit.GeometryConversion)

# Import DocumentManager and TransactionManager
clr.AddReference ("RevitServices")
import RevitServices
from RevitServices.Persistence import DocumentManager
from RevitServices.Transactions import TransactionManager

import math

doc = DocumentManager.Instance.CurrentDBDocument
uiapp = DocumentManager.Instance.CurrentUIApplication
app = uiapp.Application

#The inputs to this node will be stored as a list in the IN variable.
solids = IN[0]
categories = IN[1]




def elements_intersecting_solid_collector(solid, doc=doc, categories=[]):
	collector = DB.FilteredElementCollector(doc)
	
	if categories:
		multicategory_filter = DB.ElementMulticategoryFilter(
			List[DB.ElementId]([DB.ElementId(c.Id) for c in categories]))
		
		collector.WherePasses(multicategory_filter)
	
	solid_filter = DB.ElementIntersectsSolidFilter(solid)
	
	collector.WherePasses(solid_filter)
	
	return collector



elements = []

if solids and not isinstance(solids, list):
	solids = [solids]

if categories and not isinstance(categories, list):
	categories = [categories]

for solid in solids:
	try:
		solid = solid.ToRevitType()
	except:
		solid = solid
	
	elements.append(
		elements_intersecting_solid_collector(
			solid, 
			categories=categories).ToElements()
			)
	


OUT = elements 
# ----------------------------------------
elements = Output(python_script)
watch = Watch(pipeCurve.revit_solid)
watch_2 = Watch(pipeCurve.ds_solid)
