# Dynamo custom node GetFilledRegions.dyf (Dynamo 2.6.1.8786)
# category: Antler.Revit.Collect.Query
# Returns all instances of input filled region type or filled region type name.

filled_region_type_or_name = Input(filled_region_type_or_name: var[]..[])
python_script = Python(IN[0]=filled_region_type_or_name)
# ---------- python_script.python (44 lines) ----------
# Enable Python support and load DesignScript library
import clr

# Import RevitAPI
clr.AddReference("RevitAPI")
from Autodesk.Revit import DB

# Import DocumentManager and TransactionManager
clr.AddReference ("RevitServices")
import RevitServices
from RevitServices.Persistence import DocumentManager

#The inputs to this node will be stored as a list in the IN variables.
names = IN[0]

doc = DocumentManager.Instance.CurrentDBDocument

def filled_regions_by_name_collector(name, doc=doc):
    provider = DB.ParameterValueProvider(
        DB.ElementId(DB.BuiltInParameter.ALL_MODEL_TYPE_NAME))
        
    rule = DB.FilterStringRule(
        provider, DB.FilterStringEquals(), name, False)
        
    parameter_filter = DB.ElementParameterFilter(rule)
    
    collector = DB.FilteredElementCollector(doc)
    collector.WhereElementIsNotElementType()
    collector.OfClass(clr.GetClrType(DB.FilledRegion))
    
    collector.WherePasses(parameter_filter)

    return collector
   
def process(item):	    
	if isinstance(item, basestring):
		return filled_regions_by_name_collector(names).ToElements()
	elif isinstance(UnwrapElement(item), DB.FilledRegionType):
		return filled_regions_by_name_collector(item.Name).ToElements()
	elif isinstance(item, list):
		return [process(a) for a in item]
		
		
OUT = process(names)
# ----------------------------------------
filled_regions = Output(python_script)
