# Dynamo custom node PipeCurve.dyf (Dynamo 2.6.1.8786)
# category: Antler.Geometry.Surfaces.Solids.Pipe.Create
# Returns a round pipe solid from input curve and radius. Due to bug in Dynamo this node outputs both Revit solids and DesignScript solids. In Dynamo use ds_solid, and if you need the solid in another Python script, use revit_solid.

curve = Input(curve: var[]..[])
radius = Input(radius: var[]..[])
python_script = Python(IN[0]=curve, IN[1]=radius)
# ---------- python_script.python (73 lines) ----------
import clr

# Import RevitAPI
clr.AddReference("RevitAPI")
#import Autodesk
from Autodesk.Revit import DB

# Import List
from System.Collections.Generic import List

# Import ToDSType(bool) extension method
clr.AddReference("RevitNodes")
import Revit
#clr.ImportExtensions(Revit.Elements)
clr.ImportExtensions(Revit.GeometryConversion)

# Import DocumentManager and TransactionManager
clr.AddReference ("RevitServices")
import RevitServices
from RevitServices.Persistence import DocumentManager
from RevitServices.Transactions import TransactionManager

import math

doc = DocumentManager.Instance.CurrentDBDocument
uiapp = DocumentManager.Instance.CurrentUIApplication
app = uiapp.Application

#The inputs to this node will be stored as a list in the IN variable.
crvs = IN[0]
radius = IN[1]


if doc.DisplayUnitSystem == DB.DisplayUnit.METRIC:
	radius = radius/304.8




def pipe_from_crv(crv, radius):
	derivatives = crv.ComputeDerivatives(crv.GetEndParameter(0), True)
	
	tangent = derivatives.BasisX

	plane = DB.Plane.CreateByNormalAndOrigin(
		tangent, 
		crv.GetEndPoint(0))
	
	path = DB.CurveLoop.Create(
		List[DB.Curve]([crv]))
	
	circle0 = DB.Arc.Create(plane, radius, 0, math.pi)
	circle1 = DB.Arc.Create(plane, radius, math.pi, 2.0*math.pi)
	
	profiles = DB.CurveLoop.Create(
		List[DB.Curve]([circle0, circle1]))
	
	pipe = DB.GeometryCreationUtilities.CreateSweptGeometry(
		path, 0, 0, List[DB.CurveLoop]([profiles]))
	
	return pipe
	

pipes = []

for crv in crvs:
	pipe = pipe_from_crv(crv.ToRevitType(), radius)
	
	pipes.append(pipe)
	


OUT = pipes 
# ----------------------------------------
python_script_2 = Python(IN[0]=python_script)
# ---------- python_script_2.python (36 lines) ----------
import clr

# Import RevitAPI
clr.AddReference("RevitAPI")
#import Autodesk
from Autodesk.Revit import DB

# Import List
from System.Collections.Generic import List

# Import ToDSType(bool) extension method
clr.AddReference("RevitNodes")
import Revit
#clr.ImportExtensions(Revit.Elements)
clr.ImportExtensions(Revit.GeometryConversion)

# Import DocumentManager and TransactionManager
clr.AddReference ("RevitServices")
import RevitServices
from RevitServices.Persistence import DocumentManager
from RevitServices.Transactions import TransactionManager

import math


#The inputs to this node will be stored as a list in the IN variable.
solids = IN[0]

def process(item):
	if isinstance(item, (list, tuple)):
		return [process(a) for a in item]
	else:
		return item.ToProtoType()


OUT = process(solids)
# ----------------------------------------
ds_solid = Output(python_script_2)
revit_solid = Output(python_script)
