# Dynamo custom node PullPtToPlane.dyf (Dynamo 2.3.0.5885)
# category: Antler.Geometry.Points.Point.Actions
# Pulls a point to a plane.

plane = Input(plane: Autodesk.DesignScript.Geometry.Plane = Autodesk.DesignScript.Geometry.Plane.XY())
point = Input(point: Autodesk.DesignScript.Geometry.Point)
code_block = CodeBlock(plane=plane, pt=point)
# ---------- code_block.designscript (17 lines) ----------
// Pull point to plane

plane;
pt;

cs = CoordinateSystem.ByPlane(plane);

pt_transformed = Geometry.Transform(
	pt, CoordinateSystem.Inverse(cs));

pt_on_plane = Point.ByCoordinates(
	pt_transformed.X,
	pt_transformed.Y,
	0
);

pt_pulled = Geometry.Transform(pt_on_plane, cs);
# ----------------------------------------
point_2 = Output(code_block.pt_pulled)  # "point"
