# Dynamo custom node QueryReference.dyf (Dynamo 2.6.1.8786)
# category: Antler.Revit.Elements.Reference.Query
# Returns Element, Point, Geometry from input Reference.

reference = Input(reference: var[]..[])
element = Python(IN[0]=reference)  # "Reference.Element"
# ---------- element.python (47 lines) ----------
# Load the Python Standard and DesignScript Libraries
import sys
import clr
clr.AddReference('ProtoGeometry')
from Autodesk.DesignScript.Geometry import *

# Import RevitAPI
clr.AddReference("RevitAPI")
from Autodesk.Revit import DB

from System.Collections.Generic import List

# Import ToDSType(bool) extension method
clr.AddReference("RevitNodes")
import Revit
clr.ImportExtensions(Revit.Elements)
clr.ImportExtensions(Revit.GeometryConversion)

clr.AddReference ("RevitServices")
import RevitServices
from RevitServices.Persistence import DocumentManager

doc = DocumentManager.Instance.CurrentDBDocument

# The inputs to this node will be stored as a list in the IN variables.
references = IN[0]


# Place your code below this line
def query(reference):
	element = doc.GetElement(reference.ElementId)
	pt = reference.GlobalPoint.ToPoint()
	geometry = element.GetGeometryObjectFromReference(reference)
	
	return element
	

if not references:
	result = None

elif isinstance(references, (list, tuple)):
	result = [query(ref) for ref in references]
else:
	result = query(references)

# Assign your output to the OUT variable.
OUT = result
# ----------------------------------------
element_2 = Output(element)  # "element"
point = Python(IN[0]=reference)  # "Reference.Point"
# ---------- point.python (47 lines) ----------
# Load the Python Standard and DesignScript Libraries
import sys
import clr
clr.AddReference('ProtoGeometry')
from Autodesk.DesignScript.Geometry import *

# Import RevitAPI
clr.AddReference("RevitAPI")
from Autodesk.Revit import DB

from System.Collections.Generic import List

# Import ToDSType(bool) extension method
clr.AddReference("RevitNodes")
import Revit
clr.ImportExtensions(Revit.Elements)
clr.ImportExtensions(Revit.GeometryConversion)

clr.AddReference ("RevitServices")
import RevitServices
from RevitServices.Persistence import DocumentManager

doc = DocumentManager.Instance.CurrentDBDocument

# The inputs to this node will be stored as a list in the IN variables.
references = IN[0]


# Place your code below this line
def query(reference):
	element = doc.GetElement(reference.ElementId)
	pt = reference.GlobalPoint.ToPoint()
	geometry = element.GetGeometryObjectFromReference(reference)
	
	return pt
	

if not references:
	result = None

elif isinstance(references, (list, tuple)):
	result = [query(ref) for ref in references]
else:
	result = query(references)

# Assign your output to the OUT variable.
OUT = result
# ----------------------------------------
point_2 = Output(point)  # "point"
geometry = Python(IN[0]=reference)  # "Reference.Geometry"
# ---------- geometry.python (47 lines) ----------
# Load the Python Standard and DesignScript Libraries
import sys
import clr
clr.AddReference('ProtoGeometry')
from Autodesk.DesignScript.Geometry import *

# Import RevitAPI
clr.AddReference("RevitAPI")
from Autodesk.Revit import DB

from System.Collections.Generic import List

# Import ToDSType(bool) extension method
clr.AddReference("RevitNodes")
import Revit
clr.ImportExtensions(Revit.Elements)
clr.ImportExtensions(Revit.GeometryConversion)

clr.AddReference ("RevitServices")
import RevitServices
from RevitServices.Persistence import DocumentManager

doc = DocumentManager.Instance.CurrentDBDocument

# The inputs to this node will be stored as a list in the IN variables.
references = IN[0]


# Place your code below this line
def query(reference):
	element = doc.GetElement(reference.ElementId)
	pt = reference.GlobalPoint.ToPoint()
	geometry = element.GetGeometryObjectFromReference(reference)
	
	return geometry
	

if not references:
	result = None

elif isinstance(references, (list, tuple)):
	result = [query(ref) for ref in references]
else:
	result = query(references)

# Assign your output to the OUT variable.
OUT = result
# ----------------------------------------
revitGeometryToDSGeometry = Custom[RevitGeometryToDSGeometry](revit_geometry=geometry)  # Converts Revit geometry to Dynamo geometry.
geometry_2 = Output(revitGeometryToDSGeometry)  # "geometry"
