# Dynamo custom node ReferenceIntersectorFind.dyf (Dynamo 2.6.1.8786)
# category: Antler.Revit.Collect.Query
# Returns elements and corresponding geometry found at intersection of ray from input Point and direction Vector.
# packages: Antler 0.1.4

code_block = CodeBlock { 4; }
category = Input(category: Revit.Elements.Category)
elementCategoryFilter = Python(IN[0]=category)
# ---------- elementCategoryFilter.python (23 lines) ----------
# Load the Python Standard and DesignScript Libraries
import sys
import clr
clr.AddReference('ProtoGeometry')
from Autodesk.DesignScript.Geometry import *

# Import RevitAPI
clr.AddReference("RevitAPI")
from Autodesk.Revit import DB

import System.Enum

from System.Collections.Generic import List

# The inputs to this node will be stored as a list in the IN variables.
category = UnwrapElement(IN[0])


# Place your code below this line
element_filter = DB.ElementCategoryFilter(category.Id)

# Assign your output to the OUT variable.
OUT = element_filter
# ----------------------------------------
view_3d = Input(view_3d: Revit.Elements.Views.View)
find_reference_target = Input(find_reference_target: int = 0)  # Index of reference target to return. 0 Element An element. 1 Mesh A mesh. 2 Edge An edge. 3 Curve A curve. 4 Face A face. 5 All All target types.
python_script = Python(IN[0]=find_reference_target)
# ---------- python_script.python (20 lines) ----------
# Enable Python support and load DesignScript library
import clr

# Import RevitAPI
clr.AddReference("RevitAPI")
from Autodesk.Revit import DB

import System.Enum

# The inputs to this node will be stored as a list in the IN variables.
index = IN[0]

if index is None:
	index = 0

# Place your code below this line
target = System.Enum.GetValues(DB.FindReferenceTarget)[index]

# Assign your output to the OUT variable.
OUT = target
# ----------------------------------------
get_intersector = Python(IN[0]=elementCategoryFilter, IN[1]=view_3d, IN[2]=python_script)
# ---------- get_intersector.python (33 lines) ----------
# Load the Python Standard and DesignScript Libraries
import sys
import clr
clr.AddReference('ProtoGeometry')
from Autodesk.DesignScript.Geometry import *

# Import RevitAPI
clr.AddReference("RevitAPI")
from Autodesk.Revit import DB

from System.Collections.Generic import List



# The inputs to this node will be stored as a list in the IN variables.

element_ids_or_element_filter = IN[0]
view_3d = IN[1]
target = IN[2]


# Place your code below this line
def get_intersector(element_ids_or_element_filter, target, view_3d):
	intersector = DB.ReferenceIntersector(
		element_ids_or_element_filter, target, view_3d)
	
	return intersector

		
intersector = get_intersector(element_ids_or_element_filter, target, UnwrapElement(view_3d))

# Assign your output to the OUT variable.
OUT = intersector
# ----------------------------------------
points = Input(points: var[]..[])
direction = Input(direction: Autodesk.DesignScript.Geometry.Vector = Autodesk.DesignScript.Geometry.Vector.ByCoordinates(0, 0, -1))
find = Python(IN[0]=get_intersector, IN[1]=points, IN[2]=direction)
# ---------- find.python (69 lines) ----------
# Load the Python Standard and DesignScript Libraries
import sys
import clr
clr.AddReference('ProtoGeometry')
from Autodesk.DesignScript.Geometry import *

# Import RevitAPI
clr.AddReference("RevitAPI")
from Autodesk.Revit import DB

from System.Collections.Generic import List

# Import ToDSType(bool) extension method
clr.AddReference("RevitNodes")
import Revit
clr.ImportExtensions(Revit.Elements)
clr.ImportExtensions(Revit.GeometryConversion)

clr.AddReference ("RevitServices")
import RevitServices
from RevitServices.Persistence import DocumentManager

doc = DocumentManager.Instance.CurrentDBDocument

# The inputs to this node will be stored as a list in the IN variables.
intersector = IN[0]
origin_pts = IN[1]
direction = IN[2]

if direction:
	direction = direction.ToRevitType()

# Place your code below this line
def find(
	intersector, origin_xyz, direction=DB.XYZ(0,0,-1)):

	references_with_context = intersector.Find(origin_xyz, direction)
	
	references = []
	proximities = []

	if references_with_context:
		for reference_with_context in references_with_context:
			reference = reference_with_context.GetReference()
			
			references.append(reference)
		
			proximities.append(reference_with_context.Proximity)
			
		return references, proximities
	else:
		return [], []

result = []


for origin_pt in origin_pts:
	origin_xyz = origin_pt.ToRevitType()
	
	result.append(find(
		intersector, 
		origin_xyz,
		direction=direction
		))



# Assign your output to the OUT variable.
OUT = result
# ----------------------------------------
code_block_2 = CodeBlock { 0; }
getItemAtIndex = List.GetItemAtIndex(list=find@L3, index=code_block_2)
queryReference = Custom[QueryReference](reference=getItemAtIndex@L2)  # package Antler; Returns Element, Point, Geometry from input Reference.
element = Output(queryReference.element)
point = Output(queryReference.point)
geometry = Output(queryReference.geometry)
code_block_3 = CodeBlock { 1; }
getItemAtIndex_2 = List.GetItemAtIndex(list=find@L3, index=code_block_3)
proximity = Output(getItemAtIndex_2)
watch = Watch(queryReference.element)
watch_2 = Watch(getItemAtIndex)
watch_3 = Watch(direction)
watch_4 = Watch(getItemAtIndex_2)
watch_5 = Watch(find)
