# Dynamo custom node RevitGeometryToDSGeometry.dyf (Dynamo 2.6.1.8786)
# category: Antler.Geometry.Actions
# Converts Revit geometry to Dynamo geometry.

revit_geometry = Input(revit_geometry: var[]..[])
convertRevitGeometry = Python(IN[0]=revit_geometry)
# ---------- convertRevitGeometry.python (61 lines) ----------
# Load the Python Standard and DesignScript Libraries
import sys
import clr
clr.AddReference('ProtoGeometry')
from Autodesk.DesignScript.Geometry import *

# Import RevitAPI
clr.AddReference("RevitAPI")
from Autodesk.Revit import DB

from System.Collections.Generic import List

# Import ToDSType(bool) extension method
clr.AddReference("RevitNodes")
import Revit
clr.ImportExtensions(Revit.Elements)
clr.ImportExtensions(Revit.GeometryConversion)

clr.AddReference ("RevitServices")
import RevitServices
from RevitServices.Persistence import DocumentManager

doc = DocumentManager.Instance.CurrentDBDocument

# The inputs to this node will be stored as a list in the IN variables.
revit_geometry = IN[0]

GEOMETRY_CONVERSION_DICT = {
	DB.Face: lambda x:x.Convert(),
	DB.ConicalFace: lambda x:x.Convert(),
	DB.CylindricalFace: lambda x:x.Convert(),
	DB.HermiteFace: lambda x:x.Convert(),
	DB.PlanarFace: lambda x:x.Convert(),
	DB.RevolvedFace: lambda x:x.Convert(),
	DB.RuledFace: lambda x:x.Convert(),
	
	DB.Solid: lambda x:x.Convert(),
	
	DB.XYZ: lambda x:x.ToPoint(),
	
	DB.UV: lambda x:x.ToProtoType(),
	
}

# Place your code below this line
def convert_to_ds_geometry(revit_geometry):
	#try:
	ds_geometry = GEOMETRY_CONVERSION_DICT.get(type(revit_geometry), lambda x:None)(revit_geometry)
	#except:
	#	pass
	
	return ds_geometry
	
def walk(arg, function):
	if isinstance(arg, (list, tuple)):
		return [walk(e, function) for e in arg]
	else:
		return function(arg)

# Assign your output to the OUT variable.
OUT = walk(revit_geometry, convert_to_ds_geometry)
# ----------------------------------------
geometry = Output(convertRevitGeometry)
