# Dynamo custom node RoomAtPoint.dyf (Dynamo 2.3.0.5885)
# category: Antler.Revit.Collect.Query
# Collects room at point. Phase is a required parameter to only collect one room.

pt = Input(pt: var[]..[])
phase = Input(phase: var[]..[])
python_script = Python(IN[0]=pt, IN[1]=phase)
# ---------- python_script.python (63 lines) ----------
# Enable Python support and load DesignScript library
import clr

# Import RevitAPI
clr.AddReference("RevitAPI")
from Autodesk.Revit import DB

# Import DocumentManager and TransactionManager
clr.AddReference ("RevitServices")
import RevitServices
from RevitServices.Persistence import DocumentManager

# Import ToDSType(bool) extension method
clr.AddReference("RevitNodes")
import Revit
clr.ImportExtensions(Revit.Elements)
clr.ImportExtensions(Revit.GeometryConversion)

#The inputs to this node will be stored as a list in the IN variables.


doc = DocumentManager.Instance.CurrentDBDocument

def room_phase_filter(phase):
    phase_id = phase.Id

    provider = DB.ParameterValueProvider(
        DB.ElementId(DB.BuiltInParameter.ROOM_PHASE_ID))
    rule = DB.FilterElementIdRule(provider, DB.FilterNumericEquals(), phase_id)
    parameter_filter = DB.ElementParameterFilter(rule)

    return parameter_filter

def collect_room_at_pt(pt, phase_filter):
    collector = DB.FilteredElementCollector(doc)
    collector.OfCategory(DB.BuiltInCategory.OST_Rooms)
    # collector = room_collector(phase)

    bbox_pt_filter = DB.BoundingBoxContainsPointFilter(pt)

    collector.WherePasses(bbox_pt_filter)

    if collector.GetElementCount() > 0:

        collector.WherePasses(phase_filter)

        for room in collector.ToElements():
            if room.IsPointInRoom(pt):
                return room

if isinstance(IN[0], list):
    pts = [pt.ToXyz() for pt in IN[0]]
else:
    pts = [IN[0].ToXyz()]

phase = UnwrapElement(IN[1])


phase_filter = room_phase_filter(phase)

rooms = [collect_room_at_pt(pt, phase_filter) for pt in pts]

OUT = rooms
# ----------------------------------------
room = Output(python_script)
