# Dynamo custom node SerializePoint.dyf (Dynamo 2.6.1.8786)
# category: Antler.Geometry.Points.Point.Actions
# Serializes a Point to a Dictionary

point = Input(point: var[]..[])
python_script = Python(IN[0]=point)
# ---------- python_script.python (22 lines) ----------
# Load the Python Standard and DesignScript Libraries
import sys
import clr
clr.AddReference('ProtoGeometry')
from Autodesk.DesignScript.Geometry import *

import json

# The inputs to this node will be stored as a list in the IN variables.
pts = IN[0]

# Place your code below this line
def pt_to_dict(pt):
	return {'Point': {'X': pt.X, 'Y': pt.Y, 'Z': pt.Z}}

if isinstance(pts, list):
	output = [pt_to_dict(pt) for pt in pts]
else:
	output = pt_to_dict(pts)
	
# Assign your output to the OUT variable.
OUT = output
# ----------------------------------------
dict = Output(python_script)
