# Dynamo custom node SetLineStyle.dyf (Dynamo 2.6.1.8786)
# category: Antler.Revit.Elements.DetailItems.Actions
#  Sets the line style for all boundaries.

filled_region = Input(filled_region: var[]..[])
line_style_name = Input(line_style_name: var[]..[])
python_script = Python(IN[0]=line_style_name)
# ---------- python_script.python (35 lines) ----------
# Enable Python support and load DesignScript library
import clr

# Import RevitAPI
clr.AddReference("RevitAPI")
from Autodesk.Revit import DB

# Import DocumentManager and TransactionManager
clr.AddReference ("RevitServices")
import RevitServices
from RevitServices.Persistence import DocumentManager
from RevitServices.Transactions import TransactionManager

doc = DocumentManager.Instance.CurrentDBDocument

#The inputs to this node will be stored as a list in the IN variable.
hint = IN[0]

def function(name):
	collector = DB.FilteredElementCollector(doc).OfClass(clr.GetClrType(DB.GraphicsStyle))#.WhereElementIsNotElementType()
	
	for line_style in collector.ToElements():
		if name == line_style.Name:
			return line_style

output = None

# To handle single items or lists..
if isinstance(hint, basestring):
	output = function(hint)
elif isinstance(hint, list):
	output = [function(a) for a in hint]

#Assign your output to the OUT variable.
OUT = output
# ----------------------------------------
python_script_2 = Python(IN[0]=filled_region, IN[1]=python_script)
# ---------- python_script_2.python (42 lines) ----------
# Enable Python support and load DesignScript library
import clr

# Import RevitAPI
clr.AddReference("RevitAPI")
from Autodesk.Revit import DB

# Import DocumentManager and TransactionManager
clr.AddReference ("RevitServices")
import RevitServices
from RevitServices.Persistence import DocumentManager
from RevitServices.Transactions import TransactionManager

doc = DocumentManager.Instance.CurrentDBDocument

#The inputs to this node will be stored as a list in the IN variable.
filled_regions = IN[0]
line_style = IN[1]


def function(filled_region, line_style):
	filled_region.SetLineStyleId(line_style.Id)
	
	return filled_region


output = None


TransactionManager.Instance.EnsureInTransaction(doc)

if isinstance(filled_regions, list):
	output = [function(
		UnwrapElement(a), UnwrapElement(line_style)) for a in filled_regions]
else:
	output = function(
		UnwrapElement(filled_regions), UnwrapElement(line_style))

TransactionManager.Instance.TransactionTaskDone()

#Assign your output to the OUT variable.
OUT = output
# ----------------------------------------
filled_region_2 = Output(python_script_2)  # "filled_region"
line_style = Output(python_script)
