# Dynamo custom node Surface.Union.dyf "Planar Surface Union" (Dynamo 2.6.1.8786)
# category: Antler.Geometry.Surfaces.Surface.Actions
# Gets intersection of multiple coplanar surfaces. If surfaces intersect the node will cut away the intersecting part from one of the surfaces.

srfs = Input(srfs: var[]..[])
code_block = CodeBlock(srfs=srfs)
# ---------- code_block.designscript (34 lines) ----------
// Union of surfaces

srfs;

deconstructed = List.Deconstruct(srfs);

first = Dictionary.ValueAtKey(deconstructed, "first");
rest = Dictionary.ValueAtKey(deconstructed, "rest");


union = [Imperative]
{
	current = [first];

	for (srf in rest)
		{
		if (Surface.DoesIntersect(current, srf))
			{
			diff = Surface.Difference(current, srf);

			if (diff == null)
				{
				current = [srf];
				}
			else
				{
				current = List.Join([diff, [srf]]);
				}
			}
		}
	cleaned_list = List.Clean(current, false);

	return current;
};
# ----------------------------------------
boolean = BoolSelector(false)
clean = List.Clean(list=code_block.out4@L2, preserveIndices=boolean)
union = Output(clean)
