# Dynamo custom node UnfilterByBoolMask.dyf (Dynamo 2.6.1.8786)
# category: Antler.List.Modify.Actions
# Does the opposite of FilterByBoolMask. It weaves  two lists together based on a bool mask.

in_ = Input(in_: var[]..[])
out = Input(out_: var[]..[])
mask = Input(mask: var[]..[])
python_script = Python(IN[0]=in_, IN[1]=out, IN[2]=mask)
# ---------- python_script.python (14 lines) ----------
in_list = IN[0]
out_list = IN[1]

mask = IN[2]

new_list = []

for a in mask:
	if a:
		new_list.append(in_list.pop(0))
	else:
		new_list.append(out_list.pop(0))
		
OUT = new_list
# ----------------------------------------
list = Output(python_script)
