# Dynamo custom node WeightedMajority.dyf (Dynamo 2.6.1.8786)
# category: Antler.Math.Logic.Actions
# Returns the majority of list based on list of weights.

keys = Input(keys: var[]..[])
weights = Input(weights: var[]..[])
python_script = Python(IN[0]=keys, IN[1]=weights)
# ---------- python_script.python (11 lines) ----------
from collections import defaultdict

keys = IN[0]
weights = IN[1]

summary = defaultdict(float)

for k, w in zip(keys, weights):
	summary[k] += w

OUT = max(summary.items(), key=lambda x:x[1])[0]#, summary.items()
# ----------------------------------------
majority = Output(python_script)
