# Dynamo custom node Collector.Multicategory2.dyf "Collector.Multicategory" (Dynamo 2.6.1.8786)
# category: Antler.Revit.Collectors
# Collects all elements of multiple categories. Provide category names as strings.

doc = Input(doc: var = null)  # Optional document input
category = Input(category: string = null)  # Category as string
view = Input(view: Revit.Elements.Views.View = null)  # Optional View to find only elements in View
design_option = Input(design_option: Revit.Elements.Element = null)  # Optional Design Option to find only elements in that Design Option
get_types = Input(get_types: bool = false)  # True to get Element Types instead of Instance Elements
filters = Input(filters: var[] = null)  # Filters
python_script = Python(IN[0]=doc, IN[1]=category, IN[2]=view, IN[3]=design_option, IN[4]=get_types, IN[5]=filters)
# ---------- python_script.python (106 lines) ----------
"""
Sources:
	https://thebuildingcoder.typepad.com/blog/2010/06/element-name-parameter-filter-correction.html
"""

# Enable Python support and load DesignScript library
import clr

clr.AddReference('ProtoGeometry')
from Autodesk.DesignScript.Geometry import *

# Import RevitAPI
clr.AddReference("RevitAPI")
from Autodesk.Revit.DB import *

# Import DocumentManager and TransactionManager
clr.AddReference("RevitServices")
import RevitServices
from RevitServices.Persistence import DocumentManager
from RevitServices.Transactions import TransactionManager

# Import ToDSType(bool) extension method
clr.AddReference("RevitNodes")
import Revit
clr.ImportExtensions(Revit.Elements)
clr.ImportExtensions(Revit.GeometryConversion)

clr.AddReference('System.Collections')
from System import *
from System.Collections.Generic import *

import sys
path = r"C:\Program Files (x86)\IronPython 2.7\Lib"
if not path in sys.path: sys.path.append(path)
import difflib

import operator

import logging
#logging.basicConfig(level=logging.DEBUG)

#The inputs to this node will be stored as a list in the IN variables.
doc = IN[0]
category = IN[1]
view = UnwrapElement(IN[2])
design_option = UnwrapElement(IN[3])
get_types = IN[4]
filters = IN[5]

log = []

def to_list(item):
	if isinstance(item, list):
		return item
	else:
		return [item]



if not doc:
	doc = DocumentManager.Instance.CurrentDBDocument


if view:
	collector = FilteredElementCollector(doc, view.Id)
elif category or design_option or filters:
	collector = FilteredElementCollector(doc)
	

if design_option:
	collector.ContainedInDesignOption(design_option.Id)


if get_types:
	collector.WhereElementIsElementType()
else:
	collector.WhereElementIsNotElementType()
	



if category:
	if isinstance(category, list):
		category_ids = List[ElementId]([c.Id for c in category])
		multi_category_filter = ElementMultiCategoryFilter(category_ids)
	else:
		collector.OfCategoryId(category.Id)
		


if filters:
	filters = to_list(filters)
	for filter in filters:
		collector.WherePasses(filter)
	
# Collect Elements
log = None

try:
	elements = collector.ToElements()
except Exception as e:
	log.append(str(e))


#Assign your output to the OUT variable.
OUT = elements, log
# ----------------------------------------
code_block = CodeBlock(a=python_script) { a[0]; a[1]; a[2]; }
categories = Output(code_block.out0)
elements = Output(code_block.out1)
log = Output(code_block.out2)
code_block_2 = CodeBlock {  }
python_script_2 = Python()  # unwired: IN[0]
# ---------- python_script_2.python (38 lines) ----------
# Load the Python Standard and DesignScript Libraries
import sys
import clr
clr.AddReference('ProtoGeometry')
from Autodesk.DesignScript.Geometry import *

import sys
path = r"C:\Program Files (x86)\IronPython 2.7\Lib"
if not path in sys.path: sys.path.append(path)
import difflib

import operator

# The inputs to this node will be stored as a list in the IN variables.
category = IN[0]

# Place your code below this line
def best_fuzzy_match(str_list, search_str, min=0.33):
	ratios = [(c, difflib.SequenceMatcher(None, search_str, c).ratio() ) for c in str_list]
	
	ratios_sorted = sorted(ratios, key=lambda x: x[1])
	
	best_match  = ratios_sorted[-1]
	
	if best_match[1] > min:
		return best_match[0]
	else:
		return None
		
	category_match = best_fuzzy_match(categories_builtin, category)	
		

# Fetch all Builtin Categories
categories_builtin = [a for a in dir(BuiltInCategory) if a.StartsWith("OST")]


# Assign your output to the OUT variable.
OUT = 0
# ----------------------------------------
