# Dynamo custom node Convert Area to Value.dyf (Dynamo 0.7.3.3034)
# category: Units.Area.Create

Input = Input()
fromObject = String.FromObject(Input)
python_script = Python(IN[0]=fromObject)
# ---------- python_script.python (25 lines) ----------
import clr
clr.AddReference('ProtoGeometry')
from Autodesk.DesignScript.Geometry import *
#The inputs to this node will be stored as a list in the IN variable.
inStr = IN[0]

newStr = []

def trimString(s):
	return float(s[:-2])

"""
for i in inStr:
	newStr.append(trimString(i))
"""

newStr = trimString(inStr)

"""
for i in range(0,len(inStr)):
#	i = i.replace(' ', '')[:-2].upper()
	newStr.append(inStr[i][:-2])
"""
#Assign your output to the OUT variable
OUT = newStr
# ----------------------------------------
Output = Output(python_script)  # ""
