# Dynamo custom node Curves.CurveLoopFromCrvs.dyf "CurveLoopFromCrvs" (Dynamo 2.6.1.8786)
# category: Antler.Geometry.Curves
# Create Curveloop from input curves.

Crvs = Input(Crvs: var[]..[])
curveloop_from_curves = Python(IN[0]=Crvs)
# ---------- curveloop_from_curves.python (46 lines) ----------
# Enable Python support and load DesignScript library
import clr

clr.AddReference('ProtoGeometry')
from Autodesk.DesignScript.Geometry import *

# Import RevitAPI
clr.AddReference("RevitAPI")
from Autodesk.Revit.DB import *

# Import DocumentManager and TransactionManager
clr.AddReference("RevitServices")
import RevitServices
from RevitServices.Persistence import DocumentManager
from RevitServices.Transactions import TransactionManager

clr.AddReference('RevitNodes')
import Revit
clr.ImportExtensions(Revit.GeometryConversion)
clr.ImportExtensions(Revit.Elements)

#The inputs to this node will be stored as a list in the IN variables.
input = IN[0]

doc = DocumentManager.Instance.CurrentDBDocument
uiapp = DocumentManager.Instance.CurrentUIApplication
app = uiapp.Application

def function(crvs):
	# Do something with item and get a result
#	crv_loop = CurveLoop.Create(crvs)
	crv_loop = CurveLoop()
	[crv_loop.Append(crv.ToRevitType()) for crv in crvs]

	return crv_loop

output = None

# To handle single items or lists..
if isinstance(input, list):
	output = function(UnwrapElement(input))
else:
	output = function([input])

#Assign your output to the OUT variable.
OUT = output
# ----------------------------------------
CrvLoop = Output(curveloop_from_curves)
watch = Watch(curveloop_from_curves)
