# Dynamo custom node Room.Explode.dyf "Explode" (Dynamo 2.3.0.5885)
# category: Antler.Revit.Elements.Rooms.Query
# Get geometry and material information for each Face in geometry

room = Input(room: var[]..[])
python_script = Python(IN[0]=room)
# ---------- python_script.python (86 lines) ----------
# Sourc: https://knowledge.autodesk.com/search-result/caas/CloudHelp/cloudhelp/2016/ENU/Revit-API/files/GUID-E7B451BB-21DC-4D72-AD26-75F0C2E911E4-htm.html

import clr

clr.AddReference('ProtoGeometry')
from Autodesk.DesignScript.Geometry import *

# Import RevitAPI
clr.AddReference("RevitAPI")
import Autodesk
from Autodesk.Revit.DB import *

# Import DocumentManager and TransactionManager
clr.AddReference("RevitServices")
import RevitServices
from RevitServices.Persistence import DocumentManager
from RevitServices.Transactions import TransactionManager

# Import ToDSType(bool) extension method
clr.AddReference("RevitNodes")
import Revit
clr.ImportExtensions(Revit.Elements)
clr.ImportExtensions(Revit.GeometryConversion)

# Import Revit UI
clr.AddReference('RevitAPIUI')
from Autodesk.Revit.UI import *
#from Autodesk.Revit.UI.Selection import *

from Autodesk.DesignScript.Geometry import *

from System import *
from System.Collections.Generic import *
#The inputs to this node will be stored as a list in the IN variables.
input = IN[0]

doc = DocumentManager.Instance.CurrentDBDocument

output = None

def room_query(room):
	faces = []
	materials = []
	elements = []
	
	spatialElementBoundaryOptions = SpatialElementBoundaryOptions()
	spatialElementBoundaryOptions.SpatialElementBoundaryLocation = SpatialElementBoundaryLocation.Finish

	calculator = SpatialElementGeometryCalculator(doc, spatialElementBoundaryOptions)
	
	if room.Area == 0:
		return None, None, None
	
	results = calculator.CalculateSpatialElementGeometry(room)
	roomSolid = results.GetGeometry()
	
	for roomSolidFace in roomSolid.Faces:
		materials_tmp = []
		faces_tmp = []
		elements_tmp = []
		
		for subface in results.GetBoundaryFaceInfo(roomSolidFace):
			boundingElementface = subface.GetBoundingElementFace()
			material = doc.GetElement(boundingElementface.MaterialElementId)
			materials_tmp.append(material)
			
			boundary_element = doc.GetElement(subface.SpatialBoundaryElement.HostElementId)
			elements_tmp.append(boundary_element)
			
			face = subface.GetSubface()
			faces_tmp.append(face.Convert()[0])
			

		elements.append(elements_tmp)
		materials.append(materials_tmp)
		faces.append(faces_tmp)

	return faces, materials, elements

if isinstance(input, list):
    output = [room_query(a) for a in UnwrapElement(input)]
else:
    output = [room_query(a) for a in [UnwrapElement(input)]]

#Assign your output to the OUT variable.
OUT = output
# ----------------------------------------
transpose = List.Transpose(lists=python_script)
code_block = CodeBlock(a=transpose) { a[0]; a[1]; a[2]; }
surfaces = Output(code_block.out0)
materials = Output(code_block.out1)
elements = Output(code_block.out2)
